# Grasshopper definition GSA Model Generation.gh (Grasshopper 1.0.8)
# plug-ins: Karamba3D, GSA

series = Series(Start=0, Step=1, Count=10)
pt = ConstructPoint(XCoordinate=series, YCoordinate=0, ZCoordinate=0)
yz = YZPlane(Origin=pt)
rectangle = Rectangle(Plane=PlaneXY(0, 0, 0), XSize="-100 to 100", YSize="-100 to 100", Radius=0)  # -> Rectangle, Length
cir = Circle(Plane=yz, Radius=1)
split = SplitWithBrep(Curve=cir, Brep=rectangle.Rectangle)  # -> Curve, Points
item = ListItem(List=split.Curve, Index=0, Wrap=True)  # -> flatten(Item)
loft = Loft(Curves=item, Options={Adjust=False, Closed=False, LoftEnds=0, LoftSimp=0, LoftType=0, Rebuild=10, Refit=0.01})
mesh_uv = MeshSurface(Surface=loft, UCount="50", VCount="25", Overhang=True, Equalize=False)
xz = XZPlane(Origin=Point(0, 0, 0))
xz_2 = XZPlane(Origin=Point(0, 0, 0))
rectangle_2 = Rectangle(Plane=PlaneXY(0, 0, 0), XSize="-5 to 5", YSize="-5 to 5", Radius=0)  # -> Rectangle, Length
rectangle_3 = Rectangle(Plane=xz, XSize="-5 to 5", YSize="-5 to 5", Radius=0)  # -> Rectangle, Length
rectangle_4 = Rectangle(Plane=xz_2, XSize="-5 to 5", YSize="-5 to 5", Radius=0)  # -> Rectangle, Length
panel = Panel("25")
mesh_uv_2 = MeshSurface(Surface=rectangle_2.Rectangle, UCount="50", VCount="50", Overhang=True, Equalize=False)
mesh_uv_3 = MeshSurface(Surface=rectangle_3.Rectangle, UCount="50", VCount="50", Overhang=True, Equalize=False)
mesh_uv_4 = MeshSurface(Surface=rectangle_4.Rectangle, UCount="50", VCount="50", Overhang=True, Equalize=False)
medges = MeshEdges(Mesh=mesh_uv_3)  # -> NakedEdges, InteriorEdges, NonManifoldEdges
join = JoinCurves(Curves=medges.NakedEdges, Preserve=False)
splitatcorners = SplitAtCorners(Poly=join, Angle=Slider(0.785, range=0..1))  # -> Corners, Parts
item_2 = ListItem(List=splitatcorners.Parts, Index=2, Wrap=True)
mat = CreateMaterial(Material_type="Steel", Design_Code="EN 1993-1-1:2005", Grade="S355")
mat_2 = CreateMaterial(Material_type="Steel", Design_Code="EN 1993-1-1:2005", Grade="S355")
mat_3 = CreateMaterial(Material_type="Steel", Design_Code="EN 1993-1-1:2005", Grade="S355")
explode = Explode(Curve=item_2, Recursive=True)  # -> Segments, Vertices
explode_2 = Explode(Curve=rectangle_2.Rectangle, Recursive=True)  # -> Segments, Vertices
rdpoints = RemoveDuplicatePointsKaramba3D(Point=explode_2.Vertices, LimitDistance=0.005)  # -> OutPoint, Info, Indexes
rdpoints_2 = RemoveDuplicatePointsKaramba3D(Point=explode.Vertices, LimitDistance=0.005)  # -> OutPoint, Info, Indexes
explode_3 = Explode(Curve=rectangle_4.Rectangle, Recursive=True)  # -> Segments, Vertices
prop2d = Create2DProperty(Thickness_cm="2", Material=mat, Type="Shell", Unit="cm")
item_3 = ListItem(List=splitatcorners.Parts, Index=0, Wrap=True)
prop2d_2 = Create2DProperty(Thickness_cm="2", Material=mat_2, Type="Shell", Unit="cm")
rdpoints_3 = RemoveDuplicatePointsKaramba3D(Point=explode_3.Vertices, LimitDistance=0.005)  # -> OutPoint, Info, Indexes
loadcase = CreateLoadCase(CaseID="1", Name="DL", Type="Dead")
loadcase_2 = CreateLoadCase(CaseID="1", Name="DL", Type="Dead")
prop2d_3 = Create2DProperty(Thickness_cm="2", Material=mat_3, Type="Shell", Unit="cm")
explode_4 = Explode(Curve=item_3, Recursive=True)  # -> Segments, Vertices
support = CreateSupport(Point=rdpoints.OutPoint, Plane=PlaneXY(0, 0, 0), x=True, xx=False, y=True, yy=False, z=True, zz=False)
loadcase_3 = CreateLoadCase(CaseID="1", Name="DL", Type="Dead")
support_2 = CreateSupport(Point=rdpoints_2.OutPoint, Plane=PlaneXY(0, 0, 0), x=True, xx=True, y=True, yy=True, z=True, zz=True)
lng = ListLength(List=explode_4.Vertices)
σa = CreateAnalysisCase(Name="LC1", Description="LC1")
support_3 = CreateSupport(Point=rdpoints_3.OutPoint, Plane=PlaneXY(0, 0, 0), x=True, xx=False, y=True, yy=False, z=True, zz=False)
elem2d = Create2DElement(Geometry=mesh_uv_2, Property2D=prop2d, Preview3dSection=False)
division = Division(A=lng, B=2)
elem2d_2 = Create2DElement(Geometry=mesh_uv_3, Property2D=prop2d_2, Preview3dSection=False)
faceload = CreateFaceLoad(
    LoadCase=loadcase,
    Loadable2DObjects=elem2d,
    Axis=-1,
    Direction="z",
    Projected=False,
    Value_kN_m²="-1",
    Type="Uniform",
    Unit="kN/m²")
σt = CreateAnalysisTask(Name="LC1", casesParamIndex=2, Solver="Static")
elem2d_3 = Create2DElement(Geometry=mesh_uv_4, Property2D=prop2d_3, Preview3dSection=False)
round = Round(Number=division)  # -> Nearest, Floor, Ceiling
σt_2 = CreateAnalysisTask(AnalysisCases=σa, casesParamIndex=2, Solver="Static")
faceload_2 = CreateFaceLoad(
    LoadCase=loadcase_3,
    Loadable2DObjects=elem2d_3,
    Axis=-1,
    Direction="z",
    Projected=False,
    Value_kN_m²="-1",
    Type="Uniform",
    Unit="kN/m²")
σt_3 = CreateAnalysisTask(casesParamIndex=2, Solver="Static")
item_4 = ListItem(List=explode_4.Vertices, Index=round.Ceiling, Wrap=True)
nodeload = CreateNodeLoad(LoadCase=loadcase_2, NodeList=item_4, Direction="z", Value_kN="-1", Type="NodeForce", Unit="kN")
model = CreateModel(
    GSAGeometryIn_m=flatten([support, elem2d]),
    Load=faceload,
    AnalysisTasksCombinations=σt,
    ReMesh=True,
    Tolerance=0.01,
    Unit="m")
model_2 = CreateModel(
    GSAGeometryIn_m=flatten([support_2, elem2d_2]),
    Load=nodeload,
    AnalysisTasksCombinations=σt_2,
    ReMesh=True,
    Tolerance=0.01,
    Unit="m")
model_3 = CreateModel(
    GSAGeometryIn_m=flatten([support_3, elem2d_3]),
    Load=faceload_2,
    AnalysisTasksCombinations=σt_3,
    ReMesh=True,
    Tolerance=0.01,
    Unit="m")
panel_3 = Panel("C:\Users\Matt C\Documents\GitHub\PrincipalStressLines\Example Files\GSA  Model.gwb")
save = Button()
save_2 = SaveGSAModel(GSAModel=model_2, Save=save, FileAndPath=panel_3)
panel_4 = Panel("C:\Users\Matt C\Documents\GitHub\PrincipalStressLines\Example Files\GSA  Model.gwb")
save_3 = Button()
save_4 = SaveGSAModel(GSAModel=model_3, Save=save_3, FileAndPath=panel_4)
